# Requirement set DL0_Process_Final (R2023a)

## 1 [#34] Req - Space
Give me the answer in 15 minutes with 75% accuracy.

### 1.1 [#35] Func - Space

## 2 [#36] Req - Travel on Ground

### 2.1 [#37] Func - Travel on Ground

## 3 [#38] Req - Lift

### 3.1 [#39] Func - Lift

## 4 [#40] Req - Pitch attitude

### 4.1 [#41] Func - Pitch attitude

## 5 [#42] Req - Pitching

### 5.1 [#43] Func - Pitching Moment

## 6 [#44] Req - Yawing

### 6.1 [#45] Func - Yawing Moment

## 7 [#46] Req - Source of Energy

### 7.1 [#47] Func - Provide Energy

## 8 [#48] Req - Source of Propulsion

### 8.1 [#49] Func - Source of Propulsion

## 9 [#50] Req - Takeoff

### 9.1 [#52] Func - Takeoff

## 10 [#51] Req - Landing

### 10.1 [#53] Func - Landing

## 11 [#54] Req - Fuel Tank Volume Check

### 11.1 [#55] Func - Fuel Tank Volume Check