# Requirement set DL0_Product_Final (R2023a)

## 1 [#1] Req - Space
Aircraft shall have space for passengers and cargo

### 1.1 [#2] Func - Space
Aircraft's space should be enough for the number of passengers and the weight of the cargo

## 2 [#3] Req - Travel on Ground
Aircraft shall have a means to travel on the ground

### 2.1 [#4] Func - Travel on Ground
Aircraft travels on the ground

## 3 [#5] Req - Lift
Aircraft shall product lift

### 3.1 [#9] Func - Lift

## 4 [#6] Req - Nose up
Aircraft shall point its nose up

### 4.1 [#7] Derived Req - Pitch attitude
Aircraft shall change its pitch attitude

#### 4.1.1 [#8] Func - Pitch attitude
Generate Pitch Control

## 5 [#10] Req - Stablility
Aircraft shall be stable in flight

### 5.1 [#11] Derived Req - Pitching
Aircraft shall be stable during pitching

#### 5.1.1 [#12] Func - Pitching Moment
Generate restorative pitching moment

### 5.2 [#13] Derived Req - Yawing
Aircraft shall be stable during yawing

#### 5.2.1 [#14] Func - Yawing Moment
Generate restorative yawing moment

## 6 [#15] Req - Source of Propulsion
Aircraft shall have a source of propulsion

### 6.1 [#17] Func - Propulsive Power
Aircraft will produce thrust

## 7 [#16] Req - Source of Energy
Aircraft shall utilize a source of energy to power it during flight

### 7.1 [#18] Func - Provide Energy
Aircraft provides energy

## 8 [#19] Req - Takeoff
Aircraft shall takeoff at the designated airport

### 8.1 [#20] Func - Takeoff
Aircraft shall move from ground to air

## 9 [#21] Req - Landing
Aircraft shall land at the designated airport

### 9.1 [#22] Func - Landing
Aircraft shall move from air to ground

## 10 [#23] Req - Fuel Tank Volume Check
The Fuel Tank Volume shall be checked while being idle at the airport

### 10.1 [#24] Func - Fuel Tank Volume Check
Aircraft shall have the needed fuel for the mission