# Requirement set DL0_Stakeholder (R2023a)

## 1 [#1] Req - Carry Out a Mission Segment
The Aircraft shall carry out a mission segment from Idle, taxi to loitering and landing.

## 2 [#2] Req - Aircraft shall carry passengers and cargo
Aircraft shall carry passengers and cargo not exceeding the maximum weight