# Requirement set DL0_Stakeholder_Final (R2023a)

## 1 [#1] Req - Carry Out a Mission Segment
Aircraft shall fly a mission safely, efficiently, and effectively

### 1.1 [#2] Func - Airport
Aircraft shall be idle at the airport

### 1.2 [#39] Func - Taxi
Aircraft shall taxi to the runway

### 1.3 [#40] Func - Takeoff
Aircraft shall takeoff

### 1.4 [#41] Func - Climb to Cruise
Aircraft shall climb to cruise altitude

### 1.5 [#42] F - Cruise
Aircraft shall cruise at M0.77 & Range = 1510 nautical miles

### 1.6 [#44] F - Alternate Airport
Aircraft shall fly to an alternate airport if needed.

### 1.7 [#45] F - Loiter
Aircraft shall loiter

### 1.8 [#43] F - Descend
Aircraft shall descend

### 1.9 [#46] F - Land
Aircraft shall land

### 1.10 [#51] F - Extra Fuel
Aircraft shall have extra fuel for long range international flights

## 2 [#49] Req - Carry Passengers and Cargo