# Requirement set Product_Requirements (R2022b)

## 1 [#2] Product_R (Informational)
Aircraft Wing Should Maintain Airfoil Shape(MAS)

## 2 [#4] Product_F
Maintain the rigidity of the structure

### 2.1 [#5] Structural
calculate the deflection on the airfoil given various loads that are acting on the structure

### 2.2 [#6] Aerodynamic
minimize the drag on the airfoil while setting an upper threshold for the lift

## 3 [#7] Product_L
logical solutions to the problem

### 3.1 [#8] Wingbox (Informational)
Wingbox Structure

### 3.2 [#9] Truss
Truss Structure

## 4 [#10] Product_P
Physical Diagrams