% Requirement links of Product.slx (R2023a)

block :1 implements DL0_Product_Final.slreqx#24
block :1 derives Process.slx#10: SUAVE
block :1 derives Process.slx#15: Loftin_Equations
block :1 derives Process.slx#4: FLOPS
block :11 implements DL0_Product_Final.slreqx#22
block :11 implements DL0_Product_Final.slreqx#20
block :11 derives Process.slx#10: SUAVE
block :11 derives Process.slx#15: Loftin_Equations
block :11 derives Process.slx#4: FLOPS
block :13 implements DL0_Product_Final.slreqx#22
block :13 implements DL0_Product_Final.slreqx#20
block :13 derives Process.slx#10: SUAVE
block :13 derives Process.slx#15: Loftin_Equations
block :13 derives Process.slx#4: FLOPS